# Dynamo graph modelauditing.dyn (Dynamo 2.3.1.11775)
# packages: Rhythm 2020.1.24

# group: Get folder
directory_path = Directory("C:\Users\paulfassnidge\OneDrive - Hydrock Consultants Ltd\Documents\Revit\Test RVT Repo")
directory_from_path = DirectoryObject(path=directory_path)
code_block = CodeBlock { "*.rvt"; }
code_block_2 = CodeBlock { false; }
getDirectoryContents = FileSystem.GetDirectoryContents(directory=directory_from_path, searchString=code_block, includeSubdirectories=code_block_2)
code_block_3 = CodeBlock { true; }
rhythm_ʳʰʸᵗʰᵐ_applications = Rhythm.Revit.Application.Applications.OpenDocumentFile(filePath=getDirectoryContents.files, audit=code_block_2, detachFromCentral=code_block_3)

# group: Spaces Data
get_spaces = Python(IN[0]=rhythm_ʳʰʸᵗʰᵐ_applications)
# ---------- get_spaces.python (49 lines) ----------
# Copyright(c) 2017, Konrad K Sobon
# @arch_laboratory, http://archi-lab.net

import clr
clr.AddReference("RevitNodes")
import Revit
clr.ImportExtensions(Revit.Elements)

clr.AddReference("RevitServices")
import RevitServices
from RevitServices.Persistence import DocumentManager

#Restore local model if needed
#doc = DocumentManager.Instance.CurrentDBDocument

models = IN [0]

for doc in models:

    # Import RevitAPI
    clr.AddReference("RevitAPI")
    from Autodesk.Revit.DB import *

    import System
    from System import Array
    from System.Collections.Generic import *

    import sys
    pyt_path = r'C:\Program Files (x86)\IronPython 2.7\Lib'
    sys.path.append(pyt_path)

    try:
        errorReport = None
        
        cat_list = [BuiltInCategory.OST_MEPSpaces]
        typed_list = List[BuiltInCategory](cat_list)
        filter = ElementMulticategoryFilter(typed_list)
        output = FilteredElementCollector(doc).WherePasses(filter).ToElements()

    except:
        # if error occurs anywhere in the process catch it
        import traceback
        errorReport = traceback.format_exc()

    # Assign your output to the OUT variable
    if None == errorReport:
        OUT = output
    else:
        OUT = errorReport
# ----------------------------------------
get_rooms = Python(IN[0]=rhythm_ʳʰʸᵗʰᵐ_applications)
# ---------- get_rooms.python (49 lines) ----------
# Copyright(c) 2017, Konrad K Sobon
# @arch_laboratory, http://archi-lab.net
#Modified for input doc list by PF

import clr
clr.AddReference("RevitNodes")
import Revit
clr.ImportExtensions(Revit.Elements)

clr.AddReference("RevitServices")
import RevitServices
from RevitServices.Persistence import DocumentManager

#Switch back to current model if needed
#doc = DocumentManager.Instance.CurrentDBDocument

models = IN [0]
for doc in models:

    # Import RevitAPI
    clr.AddReference("RevitAPI")
    from Autodesk.Revit.DB import *

    import System
    from System import Array
    from System.Collections.Generic import *

    import sys
    pyt_path = r'C:\Program Files (x86)\IronPython 2.7\Lib'
    sys.path.append(pyt_path)

    try:
        errorReport = None
        
        cat_list = [BuiltInCategory.OST_Rooms]
        typed_list = List[BuiltInCategory](cat_list)
        filter = ElementMulticategoryFilter(typed_list)
        output = FilteredElementCollector(doc).WherePasses(filter).ToElements()

    except:
        # if error occurs anywhere in the process catch it
        import traceback
        errorReport = traceback.format_exc()

    # Assign your output to the OUT variable
    if None == errorReport:
        OUT = output
    else:
        OUT = errorReport
# ----------------------------------------
code_block_4 = CodeBlock { "Room Name"; }
getParameterValueByName = Element.GetParameterValueByName(element=get_rooms, parameterName=code_block_4)
code_block_5 = CodeBlock { "Type Name"; }
getParameterValueByName_2 = Element.GetParameterValueByName(element=get_rooms, parameterName=code_block_5)
code_block_6 = CodeBlock(list1=getParameterValueByName, list2=getParameterValueByName_2) { list1 + list2; }

# group: Where to send output data?
directory_path_2 = Directory("C:\Users\paulfassnidge\Desktop\Print")

# group: Get all categories
all_categories_used = Python(IN[0]=rhythm_ʳʰʸᵗʰᵐ_applications)
# ---------- all_categories_used.python (42 lines) ----------
import clr
clr.AddReference('RevitAPI')
from Autodesk.Revit.DB import *

clr.AddReference("RevitNodes")
import Revit
clr.ImportExtensions(Revit.Elements)
clr.ImportExtensions(Revit.GeometryConversion)

clr.AddReference("RevitServices")
import RevitServices
from RevitServices.Persistence import DocumentManager
from RevitServices.Transactions import TransactionManager

#doc = DocumentManager.Instance.CurrentDBDocument
models = IN [0]
for doc in models:
    categories = doc.Settings.Categories

model_cat = []
anno_cat = []
ana_cat = []
internal_cat = []

for c in categories:
	if c.CategoryType == CategoryType.Model:
		if c.SubCategories.Size > 0 or c.CanAddSubcategory:
			model_cat.append(Revit.Elements.Category.ById(c.Id.IntegerValue))

	elif c.CategoryType == CategoryType.Annotation:
		if c.SubCategories.Size > 0 or c.CanAddSubcategory:
			anno_cat.append(Revit.Elements.Category.ById(c.Id.IntegerValue))
	
	elif c.CategoryType == CategoryType.AnalyticalModel:
		if c.SubCategories.Size > 0 or c.CanAddSubcategory:
			ana_cat.append(Revit.Elements.Category.ById(c.Id.IntegerValue))
	
	elif c.CategoryType == CategoryType.Internal:
		if c.SubCategories.Size > 0 or c.CanAddSubcategory:
			internal_cat.append(Revit.Elements.Category.ById(c.Id.IntegerValue))

OUT = model_cat, anno_cat, ana_cat, internal_cat
# ----------------------------------------
flatten = List.Flatten(list=all_categories_used)

# group: Filter out Tags
string_from_object = FromObject(obj=flatten)
code_block_7 = CodeBlock { "Tag"; }
contains = String.Contains(str=string_from_object, searchFor=code_block_7)
filterByBoolMask = List.FilterByBoolMask(list=flatten, mask=contains)

# group: Filter out Tags
string_from_object_2 = FromObject(obj=filterByBoolMask.out)
code_block_8 = CodeBlock { "Analytical"; }
contains_2 = String.Contains(str=string_from_object_2, searchFor=code_block_8)
filterByBoolMask_2 = List.FilterByBoolMask(list=filterByBoolMask.out, mask=contains_2)

# group: Family Usage Count
rhythm_ʳʰʸᵗʰᵐ_collector = Rhythm.Revit.Selection.Collector.ElementsOfCategoryInDocument(document=rhythm_ʳʰʸᵗʰᵐ_applications, category=filterByBoolMask_2.out, lacing=Longest)
name = Family.Name(family=rhythm_ʳʰʸᵗʰᵐ_collector)
flatten_2 = List.Flatten(list=name)
getCategory = Element.GetCategory(element=rhythm_ʳʰʸᵗʰᵐ_collector)
flatten_3 = List.Flatten(list=getCategory)
code_block_9 = CodeBlock(list1=flatten_2, list2=flatten_3) { list1 + "_" + list2; }
groupByKey = List.GroupByKey(list=code_block_9, keys=code_block_9)
watch = Watch(groupByKey.unique_keys)
watch_2 = Watch(groupByKey.groups)
count = List.Count(list=watch_2@L2)

# group: Generate Project Name
get_project_details = Python(IN[0]=rhythm_ʳʰʸᵗʰᵐ_applications)
# ---------- get_project_details.python (39 lines) ----------
#HDT data analytics by PF

import clr
import sys

clr.AddReference("RevitServices")
clr.AddReference('DynamoRevitDS')
import RevitServices
from RevitServices.Persistence import DocumentManager

pyt_path = r'C:\Program Files (x86)\IronPython 2.7\Lib'
sys.path.append(pyt_path)

import clr
import System
import sys
import Dynamo 
import os

from System.IO import Directory
from System import Environment

DynamoRevit=Dynamo.Applications.DynamoRevit()

from datetime import datetime

#Get doc and dynamo stuff
doc = IN [0]

for x in doc:
    app = DocumentManager.Instance.CurrentUIApplication.Application
    scriptname=DynamoRevit.RevitDynamoModel.CurrentWorkspace.FileName
    name=os.path.basename(scriptname)
    filename,extention=os.path.splitext(name)
    projinfo = x.ProjectInformation
    project = projinfo.Name
    number = projinfo.Number

OUT = project
# ----------------------------------------
string_from_object_3 = FromObject(obj=get_project_details)
count_2 = List.Count(list=watch)
ofRepeatedItem = List.OfRepeatedItem(item=string_from_object_3, amount=count_2)

# group: Push data
code_block_10 = CodeBlock { "\\data.xlsx"; }
code_block_11 = CodeBlock(x=directory_path_2, y=code_block_10) { x + y; }
file_from_path = FileObject(path=code_block_11)
string_from_object_4 = FromObject(obj=file_from_path)
code_block_12 = CodeBlock { "Data"; }
code_block_13 = CodeBlock { 0; }
code_block_14 = CodeBlock()
# ---------- code_block_14.designscript (6 lines) ----------
[
"Project Name",
"Spaces",
"Family Name",
"Family Usage Count"
];
# ----------------------------------------
list_create = List.Create(item0=ofRepeatedItem, item1=code_block_6, item2=watch, item3=count)
addItemToFront = List.AddItemToFront(item=code_block_14, list=list_create, lacing=Shortest)
transpose = List.Transpose(lists=addItemToFront)
code_block_15 = CodeBlock { false; }
exportExcel = Data.ExportExcel(filePath=string_from_object_4, sheetName=code_block_12, startRow=code_block_13, startCol=code_block_13, data=transpose, overWrite=code_block_15)

uniqueItems = List.UniqueItems()  # unwired: list
